# Grasshopper definition custom_gcode_example.gh (Grasshopper 1.0.8)
# plug-ins: Pufferfish

number_slider = Slider(50, range=0..100)
xy_plane = XYPlane(Origin=Point(0, 0, 0))
number_slider_2 = Slider(5, range=0..10)
subtraction = Subtraction(A=number_slider_2, B=Slider(1, range=0..1))
center_box = CenterBox(Base=xy_plane, X=number_slider, Y=number_slider, Z=Slider(0.1, range=0..1))
unit_z = UnitZ(Factor=Slider(16, range=0..100))
linear_array = LinearArray(Geometry=center_box, Direction=unit_z, Count=number_slider_2)  # -> Geometry, Transform
multiplication = Multiplication(A=unit_z, B=subtraction)
division = Division(A=multiplication, B=Slider(2, range=0..10))
unit_z_2 = UnitZ(Factor=1)
negative = Negative(Value=division)
move = Move(Geometry=linear_array.Geometry, Motion=negative)  # -> Geometry, Transform
xz_plane = XZPlane(Origin=Point(0, 0, 0))
rotate = Rotate(Geometry=move.Geometry, Angle=1.570796327, Plane=xz_plane)  # -> Geometry, Transform
merge = Merge(Data1=move.Geometry, Data2=rotate.Geometry)
rotate_2 = Rotate(Geometry=merge, Angle=0.7853981634, Plane=xz_plane)  # -> Geometry, Transform
move_2 = Move(Geometry=rotate_2.Geometry, Motion=division)  # -> Geometry, Transform

curve = Curve([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])

# ----
# LOFT ORDERLY
curve_2 = Curve(curve)
point_on_curve = PointOnCurve(curve_2, parameter=0.5)
deconstruct = Deconstruct(Point=point_on_curve)  # -> XComponent, YComponent, ZComponent
sort_list = SortList(Keys=deconstruct.ZComponent, ValuesValuesA=curve_2)  # -> Keys, ValuesValuesA
loft_options = LoftOptions(Closed=False, Adjust=Toggle(False), Rebuild=0, Refit=0, Type=Slider(3, range=0..10))
loft = Loft(Curves=sort_list.ValuesValuesA, Options=loft_options)

cap_holes = CapHoles(Brep=loft)
brep = Brep(move_2.Geometry)
scale_nu = ScaleNU(Geometry=cap_holes, Plane=PlaneXY(0, 0, 0), ScaleX=Slider(1.01, range=0..10), ScaleY=Slider(0.624, range=0..1), ScaleZ=1)  # -> Geometry, Transform
solid_union = SolidUnion(Breps=brep)
solid_intersection = SolidIntersection(BrepsA=solid_union, BrepsB=cap_holes)
solid_difference = SolidDifference(BrepsA=solid_intersection, BrepsB=scale_nu.Geometry)
solid_difference_2 = SolidDifference(BrepsA=cap_holes, BrepsB=solid_difference)
list_item = ListItem(List=solid_difference_2, Index=Slider(0, range=0..10), Wrap=True)

# ----
# layer slices
number_slider_3 = Slider(0, range=0..100)
layer_height = Slider(0.4, range=0..1)
brep_2 = Brep(solid_difference_2)
series = Series(Start=number_slider_3, Step=layer_height, Count=Slider(100, range=0..1000))
construct_point = ConstructPoint(XCoordinate=0, YCoordinate=0, ZCoordinate=series)
data_dam = DataDam(DataDataA=brep_2, BufferDelay=10000000, BufferMode=0)
xy_plane_2 = XYPlane(Origin=construct_point)
brep_plane = BrepPlane(Brep=data_dam, Plane=xy_plane_2)  # -> Curves, Points
curve_3 = Curve(flatten(brep_plane.Curves))
list_item_2 = ListItem(List=curve_3, Index=Slider(83, range=0..100), Wrap=True)

# ----
# make sure curves are in order vertically
curve_4 = Curve(curve_3)
point_on_curve_2 = PointOnCurve(curve_4, parameter=0.5)
deconstruct_2 = Deconstruct(Point=point_on_curve_2)  # -> XComponent, YComponent, ZComponent
sort_list_2 = SortList(Keys=deconstruct_2.ZComponent, ValuesValuesA=curve_4)  # -> Keys, ValuesValuesA

# ----
# move into poition on printer bed
number_slider_4 = Slider(50, range=0..100)
vector_xyz = VectorXYZ(XComponent=number_slider_4, YComponent=Slider(43, range=0..100), ZComponent=Slider(0.2, range=0..1))  # -> Vector, Length
move_3 = Move(Geometry=sort_list_2.ValuesValuesA, Motion=vector_xyz.Vector)  # -> Geometry, Transform
curve_5 = Curve(move_3.Geometry)

# ----
# click button to
# recalculate gcode
data_dam_2 = DataDam(DataDataA=curve_5, BufferDelay=10000000, BufferMode=0)

# ----
# extrusion + speed : LAYERS
curve_6 = Curve(flatten(data_dam_2))
speed = Panel("1800")
extrusion_multiplier = Panel(".04")
# You will need to experiment with
# the extrusion multiplier and
# the speed (feed rate) values
# Reference your known working gcode files
# to make sure your extrusion amount isnt way off.
list_length = ListLength(List=curve_6)
list_length_2 = ListLength(List=curve_6)
number = Number(extrusion_multiplier)
number_2 = Number(speed)
duplicate_data = DuplicateData(Data=number_2, Number=list_length, Order=True)
duplicate_data_2 = DuplicateData(Data=number, Number=list_length_2, Order=True)
curve_7 = Curve(curve_6)
number_3 = Number(duplicate_data_2)
integer = Integer(duplicate_data)

# ----
# fillet sharp corners
number_slider_5 = Slider(0.1, range=0..0.1)
curve_8 = Curve(curve_7)
fillet = Fillet(Curve=curve_8, Radius=number_slider_5)
null_item = NullItem(Item=fillet)  # -> NullFlags, InvalidFlags, Description
pick_n_choose = PickNChoose(Pattern=null_item.InvalidFlags, Stream0=fillet, Stream1=curve_8)
curve_9 = Curve(pick_n_choose)

# ----
# straight line segments
number_slider_6 = Slider(0.023, range=0..0.1)
curve_10 = Curve(curve_9)
curve_to_polyline = CurveToPolyline(Curve=curve_10, ToleranceDistance=number_slider_6, ToleranceAngle=0)  # -> Polyline, Segments
length = Length(Curve=curve_to_polyline.Polyline)
construct_domain = ConstructDomain(DomainStart=0, DomainEnd=length)
curve_domain = CurveDomain(Curve=curve_to_polyline.Polyline, Domain=construct_domain)  # -> Curve, Domain
curve_domain_2 = CurveDomain(Curve=curve_domain.Curve)  # -> Curve, Domain
explode = Explode(Curve=curve_domain_2.Curve, Recursive=True)  # -> Segments, Vertices
clean_tree = CleanTree(RemoveNulls=True, RemoveInvalid=True, RemoveEmpty=Toggle(True), Tree=explode.Segments)
clean_tree_2 = CleanTree(RemoveNulls=True, RemoveInvalid=True, RemoveEmpty=Toggle(True), Tree=explode.Vertices)
curve_11 = Curve(simplify(clean_tree))
point = Point(clean_tree_2)

curve_12 = Curve(curve_11)

# ----
# start point of every segment
# plus end point of last segment
end_points = EndPoints(Curve=curve_12)  # -> Start, End
point_2 = Point(end_points.Start)
point_3 = Point(end_points.End)
list_item_3 = ListItem(List=reverse(point_3), Index=0, Wrap=True)
merge_2 = Merge(Data1=point_2, Data2=list_item_3)

# ----
# separate first point
point_4 = Point(merge_2)
split_list = SplitList(List=point_4, Index="1")  # -> ListA, ListB
point_5 = Point(simplify(split_list.ListA))
point_6 = Point(simplify(split_list.ListB))

number_4 = Number(integer)
number_5 = Number(number_3)

# ----
# first point of each layer
point_7 = Point(simplify(point_5))

# ----
# extrusion
length_2 = Length(Curve=curve_12)
number_6 = Number(number_5)
multiplication_2 = Multiplication(A=length_2, B=simplify(graft(number_6)))
text_join = TextJoin(Text=[" ", "E"])
round_to_decimal_place = RoundToDecimalPlace(NumberX=multiplication_2, DecimalPlace=Slider(3, range=0..10), RoundType=0)  # -> Rounded, Difference
concatenate = Concatenate(FragmentA=text_join, FragmentB=round_to_decimal_place.Rounded)

# ----
# X,Y Coords
number_slider_7 = Slider(3, range=0..10)
deconstruct_3 = Deconstruct(Point=point_7)  # -> XComponent, YComponent, ZComponent
round_to_decimal_place_2 = RoundToDecimalPlace(NumberX=deconstruct_3.XComponent, DecimalPlace=number_slider_7, RoundType=0)  # -> Rounded, Difference
round_to_decimal_place_3 = RoundToDecimalPlace(NumberX=deconstruct_3.YComponent, DecimalPlace=number_slider_7, RoundType=0)  # -> Rounded, Difference

# ----
# X,Y Coords
number_slider_8 = Slider(3, range=0..10)
deconstruct_4 = Deconstruct(Point=point_6)  # -> XComponent, YComponent, ZComponent
round_to_decimal_place_4 = RoundToDecimalPlace(NumberX=deconstruct_4.XComponent, DecimalPlace=number_slider_8, RoundType=0)  # -> Rounded, Difference
round_to_decimal_place_5 = RoundToDecimalPlace(NumberX=deconstruct_4.YComponent, DecimalPlace=number_slider_8, RoundType=0)  # -> Rounded, Difference

# ----
# set feed rate
# just once per layer
integer_2 = Integer(simplify(number_4))
list_item_4 = ListItem(List=integer_2, Index=0, Wrap=True)
concatenate_2 = Concatenate(FragmentA="G1 F", FragmentB=integer_2)  # -> graft(Result)
text = Text(simplify(concatenate_2))

# ----
# Z change
point_8 = Point(point_7)
deconstruct_5 = Deconstruct(Point=point_8)  # -> XComponent, YComponent, ZComponent
merge_3 = Merge(Data1="G1", Data2=" ", Data3="Z")
merge_4 = Merge(Data1=" ", Data2="F9000")
text_join_2 = TextJoin(Text=merge_3)
text_join_3 = TextJoin(Text=merge_4)
round_to_decimal_place_6 = RoundToDecimalPlace(NumberX=deconstruct_5.ZComponent, DecimalPlace=Slider(3, range=0..10), RoundType=0)  # -> Rounded, Difference
# for each layer
concatenate_3 = Concatenate(FragmentA=text_join_2, FragmentB=round_to_decimal_place_6.Rounded)
concatenate_4 = Concatenate(FragmentA=concatenate_3, FragmentB=text_join_3)
text_2 = Text(simplify(concatenate_4))

# ----
# do the segments
panel = Panel("G1 X")
concatenate_5 = Concatenate(FragmentA=panel, FragmentB=round_to_decimal_place_4.Rounded)
concatenate_6 = Concatenate(FragmentA=concatenate_5, FragmentB=" Y")
concatenate_7 = Concatenate(FragmentA=concatenate_6, FragmentB=round_to_decimal_place_5.Rounded)
concatenate_8 = Concatenate(FragmentA=concatenate_7, FragmentB=concatenate)
text_3 = Text(simplify(concatenate_8))

# ----
# go to starting X,Y without extruding
panel_2 = Panel("G1 X")
concatenate_9 = Concatenate(FragmentA=panel_2, FragmentB=round_to_decimal_place_2.Rounded)
concatenate_10 = Concatenate(FragmentA=concatenate_9, FragmentB=" Y")
concatenate_11 = Concatenate(FragmentA=concatenate_10, FragmentB=round_to_decimal_place_3.Rounded)
text_4 = Text(simplify(concatenate_11))

# ----
# move up from final layer
# amount to move up
number_slider_9 = Slider(5, range=0..10)
list_item_5 = ListItem(List=flatten(round_to_decimal_place_6.Rounded), Index="-1", Wrap=True)
merge_5 = Merge(Data1="G1", Data2=" ", Data3="Z")
merge_6 = Merge(Data1=" ", Data2="F800")
text_join_4 = TextJoin(Text=merge_5)
addition = Addition(A=list_item_5, B=number_slider_9)
text_join_5 = TextJoin(Text=merge_6)
concatenate_12 = Concatenate(FragmentA=text_join_4, FragmentB=addition)
concatenate_13 = Concatenate(FragmentA=concatenate_12, FragmentB=text_join_5)

# ----
# move up from final layer
# I disconnected this because I don't know the height of your printer volume.
# Take that into account before connecting this.
# 
# If it's not conntected, the print-head will simply stay in the position of the final segment at the end of your part.
text_5 = Text(concatenate_13)
text_6 = Text()

panel_3 = Panel(text_2)
panel_4 = Panel(text_4)
panel_5 = Panel(text)
merge_7 = Merge(Data1=text_2, Data2=text_4, Data3=text, Data4=text_3)
panel_6 = Panel(merge_7)

# ----
# EXPERIMENTAL
# (but also very simple and logical once you understand it ;)
# Use at your own risk
# 
# e.g. make sure your parts are within your printer's limits,
# use your own slicer's gcode as an example to follow.
# I've heard some scary noises with my printer by sending bad gcode.
# 1
# Paste first part of your gcode from your tested print here:
# Make sure your pasted gcode has these codes somewhere
# G21 ; set units to millimeters
# G90 ; use absolute coordinates
# M83 ; use relative distances for extrusion
# If it doesn't, I don't know if it will work
# (I haven't tested for a "absolute" coordinate mode, or a "relative" extrusion mode. Not sure how common that is.)
panel_7 = Panel("")

# ----
# 2
# Paste last part of your gcode from your tested print here:
# Will probably have something like:
# M140 S0 ; turn off heatbed
# M104 S0 ; turn off temperature
# M107 ; turn off fan
# M84 X Y E ; disable motors
panel_8 = Panel("")

merge_8 = Merge(Data1=flatten(panel_7), Data2=flatten(merge_7), Data3=flatten(text_6), Data4=flatten(panel_8))

# ----
# 3
# right click this panel,
# click "stream destination",
# select your save location
# 
# right click again,
# click "stream contents"
final_gcode = Panel(merge_8)
